# Grasshopper definition ifckit-test-json.gh (Grasshopper 1.0.8)

vec = VectorXYZ(XComponent=Slider(7506, range=0..10000), YComponent=Slider(300, range=0..1000), ZComponent=0)  # -> Vector, Length
rec_2pt = Rectangle2Pt(Plane=PlaneXY(0, 0, 0), PointA=Point(0, 0, 0), PointB=vec.Vector, Radius=0)  # -> Rectangle, Length
crv = Curve(rec_2pt.Rectangle)
toggle = BooleanToggle(True)
toggle_2 = BooleanToggle(True)
toggle_3 = BooleanToggle(True)
py3 = Python3Script(wall_curves=crv, height=Slider(3000, range=0..10000), name="test wall")  # -> out, json_out; inputs wall_curves: list of Polyline, height: Double, name: String
# ---------- py3: Python ----------
"""
gh_create_wall.py  —  GH Script component: "Create IFC Wall"
==============================================================

Stateless component: serializes wall curves to JSON strings.

Component inputs
----------------
wall_curves : list  — One or more closed planar Rhino curves (Polyline or
                      PolylineCurve) representing the wall base footprints.
height      : float — Wall height in the model's length unit.
name        : str   — Optional element name prefix.

Component outputs
-----------------
out     : str  — Status message.
json_out : list — List of JSON strings (one per wall).
"""

import json
from ifckit import PendingWall, Vec, Plane


def _pt(pt):
    return Vec(pt.X, pt.Y, pt.Z)


def _polyline_to_footprint(crv):
    pl = crv.ToPolyline() if hasattr(crv, "ToPolyline") else crv
    pts = [_pt(p) for p in pl]
    if len(pts) > 1:
        f, l = pts[0], pts[-1]
        if abs(f.x - l.x) < 1e-6 and abs(f.y - l.y) < 1e-6:
            pts = pts[:-1]
    return pts


messages = []
json_outputs = []

if wall_curves:
    curves = wall_curves if hasattr(wall_curves, "__iter__") else [wall_curves]

    for i, crv in enumerate(curves):
        if crv is None:
            continue
        try:
            footprint = _polyline_to_footprint(crv)
            el_name = f"{name or 'Wall'}-{i + 1}"
            wall = PendingWall(
                footprint=footprint,
                plane=Plane.world_xy(),
                height=float(height),
                name=el_name,
            )
            json_outputs.append(wall.to_json())
            messages.append(f"OK  {el_name}")
        except Exception as exc:
            messages.append(f"ERR {el_name}: {exc}")

out = "\n".join(messages) if messages else "No walls processed."
json_out = json_outputs if json_outputs else []
# ---------- end py3 ----------
panel = Panel(py3.json_out)
py3_2 = Python3Script(storey_name="test storey", walls_json=py3.json_out)  # -> out, json_out; inputs storey_name: String, walls_json: list of String, beams_json: list of String
# ---------- py3_2: Python ----------
"""
gh_collector.py  —  GH Script component: "Collect JSON Elements"
==================================================================

Stateless component: merges multiple JSON element lists and adds storey info.

Flow:  [Walls JSON] ─┐
                   ──┼──→ [Collector] ──→ [Combined JSON] ──→ [Export]
     [Beams JSON] ──┘

No sticky, no state - pure data flow.

Component inputs
----------------
walls_json  : list — List of JSON strings from CreateWalls.
beams_json  : list — List of JSON strings from CreateBeams.
storey_name : str  — Name of the storey for all elements.
                     Example: "Ground Floor", "Floor 1", etc.

Component outputs
-----------------
out     : str  — Status message.
json_out : str — JSON string with storey-wrapped elements.
                 Connect directly to Export.
"""

import json

messages = []
all_elements = []

if walls_json:
    walls = walls_json if isinstance(walls_json, list) else [walls_json]
    all_elements.extend([e for e in walls if e])
    messages.append(f"Added {len(walls)} walls")

if beams_json:
    beams = beams_json if isinstance(beams_json, list) else [beams_json]
    all_elements.extend([e for e in beams if e])
    messages.append(f"Added {len(beams)} beams")

out = ", ".join(messages) if messages else "No elements"

output_data = {
    "storeys": {
        storey_name if storey_name else "Default": all_elements
    }
}
json_out = json.dumps(output_data, separators=(",", ":"))
print(messages)
# ---------- end py3_2 ----------
button = Button()
panel_2 = Panel(py3_2.json_out)
toggle_4 = BooleanToggle(False)
relative_path = Python3Script(x="output/test_gh_json.ifc")  # -> out, a
# ---------- relative_path: Python ----------
from pathlib import Path
p = Path(ghenv.Component.OnPingDocument().FilePath).parent
 
if x:
    a = str(p / x)
else:
    a = str(p)
# ---------- end relative_path ----------
py3_3 = Python3Script(
    json_input=py3_2.json_out,
    project_name="test project",
    author="test author",
    unit="MILLIMETRE",
    ifc_output=relative_path.a,
    run_export=Toggle(True))  # -> out, a; inputs json_input: String, project_name: String, author: String, unit: String, ifc_output: String, run_export: Boolean
# ---------- py3_3: Python ----------
"""
gh_export_json.py  —  GH Script component: "Export IFC from JSON"
===================================================================

Stateless component: builds IFC from JSON and writes to file.

Each run is independent - no state, no accumulation.

Component inputs
----------------
json_input     : str  — JSON string from Collector.
project_name   : str  — IFC project name (default "GH Project").
author         : str  — Author string stored in IFC header (default "GH").
unit           : str  — "METRE" or "MILLIMETRE" (default MILLIMETRE).
ifc_output     : str  — Absolute path for the output IFC file.
run_export     : bool — Set True to actually write the file.
                          When False, reports element count.

Component outputs
-----------------
out  : str  — Status message (element count, file path, or error).

Workflow
--------
1. Wire Collector json_out to json_input here
2. Set run_export=False while testing - see what's in the model
3. Set run_export=True → IFC file is written
4. Each run is independent - no accumulation!
"""

import json
import sys

# Ensure local ifckit is on path (for development)
pkg_path = '/Users/Mauc/L140-py-ifckit'
if pkg_path not in sys.path:
    sys.path.insert(0, pkg_path)

from ifckit.json_build import build

_project_name = project_name if project_name else "GH Project"
_author = author if author else "GH"
_unit = unit.upper() if unit else "MILLIMETRE"

out = ""

if not json_input:
    out = "ERROR: no JSON input."
elif not ifc_output:
    out = "ERROR: ifc_output is empty."
elif not run_export:
    try:
        data = json.loads(json_input)
        total = sum(len(elements) for elements in data.get("storeys", {}).values())
        out = f"Model has {total} elements. Set run_export=True to export to:\n  {ifc_output}"
    except json.JSONDecodeError as exc:
        out = f"ERROR: Invalid JSON: {exc}"
else:
    try:
        data = json.loads(json_input)

        project_json = {
            "ifc_version": "IFC4",
            "project": {"name": _project_name, "author": _author},
            "unit": _unit,
            "site": {"name": "Site"},
            "buildings": [
                {
                    "name": "Building",
                    "storeys": [
                        {
                            "name": storey_name,
                            "elevation": 0.0,
                            "elements": [
                                json.loads(elem_json) if isinstance(elem_json, str) else elem_json
                                for elem_json in elements
                            ]
                        }
                        for storey_name, elements in data.get("storeys", {}).items()
                    ]
                }
            ],
        }

        build(project_json, ifc_output)
        out = f"Exported to:\n  {ifc_output}"

    except Exception as exc:
        out = f"EXPORT FAILED: {exc}"

print(out)
# ---------- end py3_3 ----------
py3_4 = Python3Script()  # -> out, a
# ---------- py3_4: Python ----------
import ifckit
print("build:", hasattr(ifckit, 'build'))
print("file:", ifckit.__file__)
# ---------- end py3_4 ----------
panel_3 = Panel(py3_3.out)
py3_5 = Python3Script(x=py3_4.a)  # -> out, a
# ---------- py3_5: Python ----------
print(x)
# ---------- end py3_5 ----------
